# Grasshopper definition DynamicRelaxation.gh (Grasshopper 0.9.61)
# plug-ins: Python Interpreter

fconstrained_points = Point([Point(-10, 15, 0), Point(-5, 15, 0), Point(-5, -15, 0), Point(-10, -15, 0)])
bendings = Curve([<curve referenced from the Rhino model> x7])
elastics = Curve()
cables = Curve()
fixed_points = Point([<point referenced from the Rhino model> x4])
second_moment_of_area = Slider(0.25, range=0..1)
second_moment_of_area_2 = Slider(0.25, range=0..1)
second_moment_of_area_3 = Slider(0.25, range=0..1)
e_value = Slider(0.25, range=0..1)
e_value_2 = Slider(0.25, range=0..1)
e_value_3 = Slider(0.25, range=0..1)
etc = Slider(0.25, range=0..1)
etc_2 = Slider(0.25, range=0..1)
etc_3 = Slider(0.25, range=0..1)
step_size = Slider(2160.568, range=1..5000)
# Also, if you right click an input parameter you can tell python what type of variable it is using the 'type hint' in the bottom
run = BooleanToggle(False)
reset = BooleanToggle(False)
timer = Timer(TimerInterval=2, Target=dynamic_relaxation_engine)
panel = Panel(["MATERIAL TWO", e_value, second_moment_of_area, etc])
panel_2 = Panel(["MATERIAL THREE", e_value_2, second_moment_of_area_2, etc_2])
panel_3 = Panel(["MATERIAL ONE", e_value_3, second_moment_of_area_3, etc_3])
dynamic_relaxation_engine = PythonScript(bendings=bendings, fixedPoints=fixed_points, constrainedPoints=fconstrained_points, run=run, reset=reset, step=step_size)  # -> out, bendingsOUT, elasticsOUT, cablesOUT, loadsOUT, fixedPointsOUT, particles; inputs bendings: list, elastics: list, cables: list, loads: list, fixedPoints: list of Point3d, constrainedPoints: list of Point3d
# ---------- dynamic_relaxation_engine: Python ----------
import Rhino # this is all the Rhino common classes and stuff (documentation here: http://4.rhino3d.com/5/rhinocommon/)
import rhinoscriptsyntax as rs

import sys

#import DynamicRelaxationFaster as DynamicRelaxation
import DynamicRelaxation


"""This component takes as input different sets of lines to define a dynamic relaxation (DR) process to find their equilibrium position.

This is the first example of a (hopefully) running code.

There are of course several things that need to be done:
    
    TODO allow for different materials in same kind of elements (e.g. tow different bending stiffnesses) maybe as pairs sets [ [list,material],[otherlist]other material]]
    TODO have a way to define generic materials (young modulus E + section area A + second moment of inertia I)(as a python class?)
    TODO add load elements as triple [position, direction, value]

The code is heavily inspired by the TraerPhysics library for Processing by J. Traer and several amendments/improvements 
made by Guillaume Labelle and Julien Nembrini in TraerAnar as a link to the ANAR+ library (http://anar.ch) 

This code is copyrighted by Julien Nembrini and distributed open source in the sense of the Gnu GPL v3.0. 

"""

#@@@@@@@@@@@@@@@@@@@@@@@@@@@@@@@
#@@@@@@@@@@@@@@@@@@@@@@@@@@@@@@@
#@@@@@@@@@@@@@@@@@@@@@@@@@@@@@@@
#@@@@@@@@@@@@@@@@@@@@@@@@@@@@@@@

def makePtFromRhino(pt):
    return DynamicRelaxation.Point3D(pt.X,pt.Y,pt.Z)
    
def makePtsFromRhino(pts):
    a = []
    for pt in pts:
        a.append(makePtFromRhino(pt))
    return a
    
#@@@@@@@@@@@@@@@@@@@@@@@@@@@@@@@
#@@@@@@@@@@@@@@@@@@@@@@@@@@@@@@@
#@@@@@@@@@@@@@@@@@@@@@@@@@@@@@@@
#@@@@@@@@@@@@@@@@@@@@@@@@@@@@@@@

print 'A prototype for dynamic relaxation in Rhino/GH/python. (c) Julien Nembrini'

#print sys.path

#@@@@@@@@@@@@@@@@@@@@@@@@@@@@@@@
#@@@@@@@@@@@@@@@@@@@@@@@@@@@@@@@
#@@@@@@@@@@@@@@@@@@@@@@@@@@@@@@@
#@@@@@@@@@@@@@@@@@@@@@@@@@@@@@@@

# Initialisation

if reset :
    
    # create particle system no drag no gravity
    ps = DynamicRelaxation.ParticleSystem()
    #ps = ParticleSystem(Vector3D(0,0,1), 0.5)
    #ps.setIntegrator(DynamicRelaxation.ParticleSystem.EULER)
    
    print ps
    
    #print bendings
    #print fixedPoints
    
    #### bending elements
    
    allBendings = [] 
    allBendingsParts = [] 
    
    for crv in bendings:
        if crv.IsPolyline() :
            # get the points out of the curve
            pts = rs.PolylineVertices(crv)
            if pts: 
                #print pts
                
                #create the bending elements (registered automagically in ps)
                parts,bends = DynamicRelaxation.makeBendingsFromList(ps, makePtsFromRhino(pts),28000e06,7e-09,2.01062e-04)
                
                # keep a copy for display of the particles making a bending line
                allBendingsParts.append(parts)
                allBendings.append(bends)
    
    print 'bendings :' + str(len(ps.bendings))
    
    #### elastic elements
    #DynamicRelaxation.makeElasticsFromList(ps, makePtsFromRhino(pts))
    
    allElastics = [] 
    allElasticsParts = [] 
    
    for crv in elastics:
        if crv.IsPolyline() :
            # get the points out of the curve
            pts = rs.PolylineVertices(crv)
            if pts: 
                #print pts
                
                #create the bending elements (registered automagically in ps)
                parts,elas = DynamicRelaxation.makeElasticsFromList(ps, makePtsFromRhino(pts))
                
                # keep a copy for display of the particles making a bending line
                allElasticsParts.append(parts)
                allElastics.append(elas)
    
    print 'elastics :' + str(len(ps.elastics))
    
    #### cables elements
    #DynamicRelaxation.makeElasticsFromList(ps, makePtsFromRhino(pts))
    
    allCables = [] 
    allCablesParts = [] 
    
    for crv in cables:
        if crv.IsPolyline() :
            # get the points out of the curve
            pts = rs.PolylineVertices(crv)
            if pts: 
                #print pts
                
                #create the bending elements (registered automagically in ps)
                parts,cabls = DynamicRelaxation.makeCablesFromList(ps, makePtsFromRhino(pts))
                
                # keep a copy for display of the particles making a bending line
                allCablesParts.append(parts)
                allCables.append(cabls)
    
    print 'cables :' + str(len(ps.cables))
    
    # TODO make a construction loop for all these kind of elements
    #DynamicRelaxation.makeSpringsFromList(ps, makePtsFromRhino(pts),1,0)
    
    #DynamicRelaxation.makeCablesFromList(ps, makePtsFromRhino(pts))
    #DynamicRelaxation.makeAttractionsFromList(ps, makePtsFromRhino(pts),100)
    #DynamicRelaxation.makeLoadsFromList(ps, makePtsFromRhino(pts[3:5]))
    
    # constrain particles
    DynamicRelaxation.makeConstraintsFromList(ps, makePtsFromRhino(constrainedPoints))
    
    # fix particles at the end
    for pt in fixedPoints:
        ps.findParticleEqualToPoint(makePtFromRhino(pt)).makeFixed()
    
    print 'particles :' + str(len(ps.particles))
    
    
    stepCount = 0

#@@@@@@@@@@@@@@@@@@@@@@@@@@@@@@@
#@@@@@@@@@@@@@@@@@@@@@@@@@@@@@@@
#@@@@@@@@@@@@@@@@@@@@@@@@@@@@@@@
#@@@@@@@@@@@@@@@@@@@@@@@@@@@@@@@

# Dynamic Relaxation step

if run:
    for i in range(10):
        ps.step(step)
    ps.stepRelax(step)
    stepCount += 1
    print stepCount


#@@@@@@@@@@@@@@@@@@@@@@@@@@@@@@@
#@@@@@@@@@@@@@@@@@@@@@@@@@@@@@@@
#@@@@@@@@@@@@@@@@@@@@@@@@@@@@@@@
#@@@@@@@@@@@@@@@@@@@@@@@@@@@@@@@

# Display functions


#center = Rhino.Geometry.Point3d((supportPtsIn[0].X + supportPtsIn[1].X) * .5, (supportPtsIn[0].Y + supportPtsIn[1].Y) * .5, (supportPtsIn[0].Z + supportPtsIn[1].Z) * .5)

bendingsOUT = []

# compare bending force between top and bottom of arch 
print allBendings[0][5].getStress() # top
print allBendings[0][0].getStress() # bottom

for bend in allBendingsParts:
    parts = []
    for p in bend :
        part = Rhino.Geometry.Point3d(p.position.x(), p.position.y(), p.position.z())
        parts.append(part)
        bendingsOUT.append(Rhino.Geometry.PolylineCurve(parts))
        
for elas in allElasticsParts:
    parts = []
    for p in elas :
        part = Rhino.Geometry.Point3d(p.position.x(), p.position.y(), p.position.z())
        parts.append(part)
        elasticsOUT.append(Rhino.Geometry.PolylineCurve(parts))
        
for cabl in allCablesParts:
    parts = []
    for p in cabl :
        part = Rhino.Geometry.Point3d(p.position.x(), p.position.y(), p.position.z())
        parts.append(part)
        cablessOUT.append(Rhino.Geometry.PolylineCurve(parts))
        

particles = []
for p in ps.particles:
    part = Rhino.Geometry.Point3d(p.position.x(), p.position.y(), p.position.z())
    particles.append(part)
    

#curveOut = Rhino.Geometry.PolylineCurve(pts)
# ---------- end dynamic_relaxation_engine ----------
path_mapper = PathMapper(panel_2, source="{0}", target="{2}")
path_mapper_2 = PathMapper(panel, source="{0}", target="{1}")
path_mapper_3 = PathMapper(panel_3, source="{0}", target="{0}")
pt = Point(dynamic_relaxation_engine.particles)
crv = Curve(dynamic_relaxation_engine.bendingsOUT)
panel_4 = Panel(dynamic_relaxation_engine.out)
panel_5 = Panel([path_mapper_3, path_mapper_2, path_mapper])
